# Grasshopper definition GeoMining_components.gh (Grasshopper 1.0.8)
# plug-ins: Hops

crv = Curve(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)
crv_2 = Curve(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)
crv_3 = Curve(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)
crv_4 = Curve(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)
crv_5 = Curve(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)
crv_6 = Curve(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)

# ----
# .../ee_filterDate
panel = Panel("MODIS/061/MOD11A1")
panel_2 = Panel("""2017-06-01
2017-08-31""")
hops = Hops(
    Layer=panel,
    Dates=panel_2,
    CacheResultsInMemory=False,
    CacheSolveResults=True,
    RemoteDefinitionLocation="http://127.0.0.1:5000/ee_filterDate",
    RemoteSolveVersion=(0, 1, 0),
    ShowInput_Enabled=False,
    ShowInput_Path=False,
    SynchronousSolve=True)  # -> Layers, Days

disc = Discontinuity(Curve=crv, Level=1)  # -> flatten(Points), Parameters
disc_2 = Discontinuity(Curve=crv_2, Level=1)  # -> flatten(Points), Parameters
disc_3 = Discontinuity(Curve=crv_3, Level=1)  # -> flatten(Points), Parameters
disc_4 = Discontinuity(Curve=crv_4, Level=1)  # -> flatten(Points), Parameters
divide = DivideCurve(Curve=crv_5, Count="200", Kinks=False)  # -> flatten(Points), Tangents, Parameters
panel_3 = Panel("""511=1
512=1
521=1
522=1
523=1""")
pt = Point(Point(9.06182161, 39.24296148, 0))
pt_2 = Point(Point(9.06182161, 39.24296148, 0))

fragment = TextFragment(Text=hops.Days, Start=Slider(0, range=0..10), Count=Slider(7, range=0..10))
cset = CreateSet(List=fragment)  # -> Set, Map
mindex = MemberIndex(Set=fragment, Member=cset.Set)  # -> Index, Count

# ----
# .../ee_image
hops_2 = Hops(
    Layer="COPERNICUS/CORINE/V20/100m/2012",
    Bands="landcover",
    Mode="mode",
    Scale=Slider(100, range=0..1000),
    Pts=disc.Points,
    CacheResultsInMemory=True,
    CacheSolveResults=True,
    RemoteDefinitionLocation="http://127.0.0.1:5000/ee_image",
    RemoteSolveVersion=(0, 1, 0),
    ShowInput_Enabled=False,
    ShowInput_Path=False,
    SynchronousSolve=False)  # -> Values, W, H

reproj = Hops(
    Points=disc.Points,
    Bool=Toggle(True),
    CacheResultsInMemory=False,
    CacheSolveResults=False,
    RemoteDefinitionLocation="http://127.0.0.1:5000/reproject_UTM",
    RemoteSolveVersion=(0, 1, 0),
    ShowInput_Enabled=False,
    ShowInput_Path=False,
    SynchronousSolve=False)
pline = PolyLine(Vertices=reverse(reproj), Closed=invert(False))
mplane = MeshPlane(Boundary=pline, WidthCount=hops_2.W, HeightCount=hops_2.H)  # -> Mesh, Area

# ----
# .../ee_nd
hops_3 = Hops(
    Layer="LANDSAT/LE7_TOA_5YEAR/1999_2003",
    Band1="B4",
    Band2="B3",
    Mode="mean",
    Scale=Slider(100, range=0..1000),
    Pts=disc_2.Points,
    CacheResultsInMemory=True,
    CacheSolveResults=True,
    RemoteDefinitionLocation="http://127.0.0.1:5000/ee_nd",
    RemoteSolveVersion=(0, 1, 0),
    ShowInput_Enabled=False,
    ShowInput_Path=False,
    SynchronousSolve=False)  # -> Values, W, H

reproj_2 = Hops(
    Points=disc_2.Points,
    Bool=Toggle(True),
    CacheResultsInMemory=True,
    CacheSolveResults=True,
    RemoteDefinitionLocation="http://127.0.0.1:5000/reproject_UTM",
    RemoteSolveVersion=(0, 1, 0),
    ShowInput_Enabled=False,
    ShowInput_Path=False,
    SynchronousSolve=False)
pline_2 = PolyLine(Vertices=reverse(reproj_2), Closed=invert(False))
mplane_2 = MeshPlane(Boundary=pline_2, WidthCount=hops_3.W, HeightCount=hops_3.H)  # -> Mesh, Area

# ----
# .../ee_cumCost
hops_4 = Hops(
    Layer="Oxford/MAP/friction_surface_2019",
    Cost="friction",
    Sources=pt,
    Maxdistance=Slider(20000, range=0..100000),
    Scale=Slider(100, range=0..1000),
    Bbox=disc_4.Points,
    CacheResultsInMemory=True,
    CacheSolveResults=True,
    RemoteDefinitionLocation="http://127.0.0.1:5000/ee_cumCost",
    RemoteSolveVersion=(0, 1, 0),
    ShowInput_Enabled=False,
    ShowInput_Path=False,
    SynchronousSolve=False)  # -> Values, W, H

reproj_3 = Hops(
    Points=disc_4.Points,
    Bool=Toggle(True),
    CacheResultsInMemory=True,
    CacheSolveResults=True,
    RemoteDefinitionLocation="http://127.0.0.1:5000/reproject_UTM",
    RemoteSolveVersion=(0, 1, 0),
    ShowInput_Enabled=False,
    ShowInput_Path=False,
    SynchronousSolve=False)
pline_3 = PolyLine(Vertices=reverse(reproj_3), Closed=invert(False))
mplane_3 = MeshPlane(Boundary=pline_3, WidthCount=hops_4.W, HeightCount=hops_4.H)  # -> Mesh, Area

# ----
# .../ee_cumCostExtra
hops_5 = Hops(
    Layer="COPERNICUS/CORINE/V20/100m/2012",
    Cost="landcover",
    Remap=panel_3,
    Default=Slider(0.1, range=0..0.1),
    Paint=divide.Points,
    Val=Slider(0.012, range=0..0.1),
    Sources=pt_2,
    Maxdistance=Slider(30000, range=0..100000),
    Scale=Slider(100, range=0..1000),
    BoundingBox=disc_3.Points,
    CacheResultsInMemory=False,
    CacheSolveResults=False,
    RemoteDefinitionLocation="http://127.0.0.1:5000/ee_cumCostExtra",
    RemoteSolveVersion=(0, 1, 0),
    ShowInput_Enabled=False,
    ShowInput_Path=False,
    SynchronousSolve=False)  # -> Values, W, H

cset_2 = CreateSet(List=hops_2.Values)  # -> Set, Map
lng = ListLength(List=cset_2.Set)
wheel = ColourWheel(
    lng,
    ColourGrips_Style=31,
    ColourGrips_Grip=[2.166918358, 4.26131346, 0.07252325533, 5.308511011],
    ColourGrips_Lum=[0.5783285674, 0.8521423836],
    ColourGrips_Range=[1.093574825, 1.093574825, 1.093574825, 1.093574825],
    ColourGrips_Sat=[0.8135900738, 1])
item = ListItem(List=wheel, Index=cset_2.Map, Wrap=True)

bnd = Bounds(Numbers=hops_3.Values)
dedomain = DeconstructDomain(Domain=bnd)  # -> Start, End
gradient = Gradient(
    LowerLimit=dedomain.Start,
    UpperLimit=dedomain.End,
    Parameter=hops_3.Values,
    stops=[0: RGB(243, 57, 0), 0.1: RGB(236, 27, 60), 0.2: RGB(210, 0, 118), 0.3: RGB(103, 0, 120), 0.4: RGB(39, 72, 161), 0.5: RGB(1, 192, 229), 0.6: RGB(18, 178, 90), 0.7: RGB(79, 186, 8), 0.8: RGB(220, 237, 32), 0.9: RGB(247, 159, 20), 1: RGB(0, 0, 0)])

bnd_2 = Bounds(Numbers=hops_4.Values)
dedomain_2 = DeconstructDomain(Domain=bnd_2)  # -> Start, End
gradient_2 = Gradient(
    LowerLimit=dedomain_2.Start,
    UpperLimit=dedomain_2.End,
    Parameter=hops_4.Values,
    stops=[0: RGB(243, 57, 0), 0.1: RGB(236, 27, 60), 0.2: RGB(210, 0, 118), 0.3: RGB(103, 0, 120), 0.4: RGB(39, 72, 161), 0.5: RGB(1, 192, 229), 0.6: RGB(18, 178, 90), 0.7: RGB(79, 186, 8), 0.8: RGB(220, 237, 32), 0.9: RGB(247, 159, 20), 1: RGB(0, 0, 0)])

bnd_3 = Bounds(Numbers=hops_5.Values)
dedomain_3 = DeconstructDomain(Domain=bnd_3)  # -> Start, End
gradient_3 = Gradient(
    LowerLimit=dedomain_3.Start,
    UpperLimit=Slider(2860, range=0..10000),
    Parameter=hops_5.Values,
    stops=[0: RGB(243, 57, 0), 0.1: RGB(236, 27, 60), 0.2: RGB(210, 0, 118), 0.3: RGB(103, 0, 120), 0.4: RGB(39, 72, 161), 0.5: RGB(1, 192, 229), 0.6: RGB(18, 178, 90), 0.7: RGB(79, 186, 8), 0.8: RGB(220, 237, 32), 0.9: RGB(247, 159, 20), 1: RGB(243, 57, 0)])

item_2 = ListItem(List=hops.Layers, Index=mindex.Index, Wrap=True)
disc_5 = Discontinuity(Curve=crv_6, Level=1)  # -> flatten(Points), Parameters
item_3 = ListItem(List=item_2, Index=0, Wrap=True)  # -> flatten(Item)

demesh = DeconstructMesh(Mesh=mplane.Mesh)  # -> Vertices, Faces, Colours, Normals
conmesh = ConstructMesh(Vertices=demesh.Vertices, Faces=demesh.Faces, Colours=item)

demesh_2 = DeconstructMesh(Mesh=mplane_2.Mesh)  # -> Vertices, Faces, Colours, Normals
conmesh_2 = ConstructMesh(Vertices=demesh_2.Vertices, Faces=demesh_2.Faces, Colours=gradient)

demesh_3 = DeconstructMesh(Mesh=mplane_3.Mesh)  # -> Vertices, Faces, Colours, Normals
conmesh_3 = ConstructMesh(Vertices=demesh_3.Vertices, Faces=demesh_3.Faces, Colours=gradient_2)

# ----
# .../ee_image
hops_6 = Hops(
    Layer=item_3,
    Bands="LST_Day_1km",
    Mode="mean",
    Scale=Slider(500, range=0..1000),
    Pts=disc_5.Points,
    CacheResultsInMemory=False,
    CacheSolveResults=True,
    RemoteDefinitionLocation="http://127.0.0.1:5000/ee_image",
    RemoteSolveVersion=(0, 1, 0),
    ShowInput_Enabled=False,
    ShowInput_Path=False,
    SynchronousSolve=True)  # -> Values, W, H

flip = FlipMatrix(Data=hops_6.Values)
avr = Average(Input=flip)  # -> flatten(ArithmeticMean)

bnd_4 = Bounds(Numbers=avr)
dedomain_4 = DeconstructDomain(Domain=bnd_4)  # -> Start, End
gradient_4 = Gradient(
    LowerLimit=dedomain_4.End,
    UpperLimit=dedomain_4.Start,
    Parameter=avr,
    stops=[0: RGB(234, 38, 0), 0.25: RGB(234, 126, 0), 0.5: RGB(254, 244, 84), 0.75: RGB(173, 203, 249), 1: RGB(75, 107, 169)])

# ---- group: .../reproject_UTM
reproj_4 = Hops(
    Points=disc_3.Points,
    Bool=Toggle(True),
    CacheResultsInMemory=True,
    CacheSolveResults=True,
    RemoteDefinitionLocation="http://127.0.0.1:5000/reproject_UTM",
    RemoteSolveVersion=(0, 1, 0),
    ShowInput_Enabled=False,
    ShowInput_Path=False,
    SynchronousSolve=False)

# ----
pline_4 = PolyLine(Vertices=reverse(reproj_4), Closed=invert(False))
mplane_4 = MeshPlane(Boundary=pline_4, WidthCount=hops_5.W, HeightCount=hops_5.H)  # -> Mesh, Area

demesh_4 = DeconstructMesh(Mesh=mplane_4.Mesh)  # -> Vertices, Faces, Colours, Normals
conmesh_4 = ConstructMesh(Vertices=demesh_4.Vertices, Faces=demesh_4.Faces, Colours=gradient_3)

# ---- group: .../reproject_UTM
reproj_5 = Hops(
    Points=disc_5.Points,
    Bool=Toggle(True),
    CacheResultsInMemory=True,
    CacheSolveResults=True,
    RemoteDefinitionLocation="http://127.0.0.1:5000/reproject_UTM",
    RemoteSolveVersion=(0, 1, 0),
    ShowInput_Enabled=False,
    ShowInput_Path=False,
    SynchronousSolve=False)

# ----
pline_5 = PolyLine(Vertices=reverse(reproj_5), Closed=invert(False))
mplane_5 = MeshPlane(Boundary=pline_5, WidthCount=hops_6.W, HeightCount=hops_6.H)  # -> Mesh, Area

item_4 = ListItem(List=mplane_5.Mesh, Index=0, Wrap=True)

demesh_5 = DeconstructMesh(Mesh=item_4)  # -> Vertices, Faces, Colours, Normals
conmesh_5 = ConstructMesh(Vertices=demesh_5.Vertices, Faces=demesh_5.Faces, Colours=gradient_4)
